% Simulink data dictionary asbCubeSatModelData.sldd

vehicle = struct(mass=1, inertia=[1 0 0; 0 1 0; 0 0 1])

ACSOutBus = Simulink.Bus()
  AttitudeError: AttitudeErrorBus
  TorqueCmds: double[3]
  cmd_q_b2tgt: double[4]
  NavMode: double

FCSOutBus = Simulink.Bus()
  ACSOut: ACSOutBus

AttitudeErrorBus = Simulink.Bus()
  Roll: double
  Pitch: double
  Yaw: double

EnvBus = Simulink.Bus()
  envAccel_ecef: double[3]
  envForces_body: double[3]
  envTorques_body: double[3]
  x_sun_eci: double[3]
  earthAngRate: double[3]

gains = struct(Kp=5.5e-5, Ki=0, Kd=0.017)

StatesOutBus = Simulink.Bus()
  utc_JD: double
  X_ecef: double[3]
  V_ecef: double[3]
  X_eci: double[3]
  V_eci: double[3]
  q_ecef2b: double[4]
  q_eci2b: double[4]
  Euler: double[3]
  LatLonAlt: double[3]
  SunAngle: double
  SunInView: boolean

CubeSatTimeStep = 1

initCond = struct(
  simStartDate=struct(JD=2458485, dateVector=[2019 1 1 12 0 0]),
  CoordEpoch=struct(JD=2451545, dateVector=[2000 1 1 12 0 0]),
  OrbitalElements=struct(
    semiMajorAxis=6786233.13,
    eccentricity=7.1e-5,
    inclination=51.6,
    RAAN=92.58,
    argumentOfPerigee=349.1886,
    trueAnomoly=285,
    trueLongitude=0,
    argumentOfLatititude=0,
    longitudeOfPerigee=0),
  r_eci=[4177345 684389.6 -5304024],
  v_eci=[-691.7543 7620.2 439.1112],
  r_ecef=[98349.69 4241377 -5296444],
  v_ecef=[-7308.162 715.1395 437.6498],
  lla=[-51.48086 88.67165 421021.5],
  v_ned=[699.3806 7322.776 2.674184],
  uvw=[699.3806 7322.776 2.674184],
  euler=[0 0 0],
  pqr=[0 0 0])