% Simulink data dictionary asbCubeSatModelData.sldd

vehicle = struct(mass=1, inertia=[1 0 0; 0 1 0; 0 0 1])

ACSOutBus = Simulink.Bus()
  AttitudeError: AttitudeErrorBus
  TorqueCmds: double[3]
  cmd_q_b2tgt: double[4]
  NavMode: double

FCSOutBus = Simulink.Bus()
  ACSOut: ACSOutBus

AttitudeErrorBus = Simulink.Bus()
  Roll: double
  Pitch: double
  Yaw: double

EnvBus = Simulink.Bus()
  envAccel_ecef: double[3]
  envForces_body: double[3]
  envTorques_body: double[3]
  x_sun_eci: double[3]
  earthAngRate: double[3]

gains = struct(Kp=5.5e-5, Ki=0, Kd=0.017)

StatesOutBus = Simulink.Bus()
  utc_JD: double
  X_ecef: double[3]
  V_ecef: double[3]
  X_eci: double[3]
  V_eci: double[3]
  q_ecef2b: double[4]
  q_eci2b: double[4]
  Euler: double[3]
  LatLonAlt: double[3]
  SunAngle: double
  SunInView: boolean

CubeSatTimeStep = 0.1

initCond = struct(
  simStartDate=struct(JD=2461410, dateVector=[2027 1 4 12 0 0]),
  CoordEpoch=struct(JD=2451545, dateVector=[2000 1 1 12 0 0]),
  OrbitalElements=struct(
    semiMajorAxis=6786233.13,
    eccentricity=0.0010537,
    inclination=51.7519,
    RAAN=95.2562,
    argumentOfPerigee=93.4872,
    trueAnomoly=302.9234,
    trueLongitude=0,
    argumentOfLatititude=0,
    longitudeOfPerigee=0),
  r_eci=[-2981784 5207056 3161595],
  v_eci=[-3384.483 -4887.76 4843.461],
  r_ecef=[-5761795 -1689753 3153824],
  v_ecef=[3834.813 -4025.837 4834.373],
  lla=[27.85969 -163.6552 408845.1],
  v_ned=[5464.227 4942.315 -7.443833],
  uvw=[6324.296 3642.739 1008.982],
  euler=[90 30 50],
  pqr=[10 10 10])